# Dynamo graph Copy element from Linked RVT.dyn (Dynamo 1.2.1.3083)

links = Links()
categories = Categories("Rooms")
boolean = BoolSelector(true)
linkedInstanceElements = Custom[Springs.Collector.LinkedInstanceElements](linkInstance=links, category=categories, refresh=boolean)  # Extract elements by category from the selected linked instances. The transform vector can be used to get the exact location of the elements in the local file
watch = Watch(linkedInstanceElements.elements)
levels = Levels()
createRoomAtPointAndLevel = Custom[Tool.CreateRoomAtPointAndLevel](Level=levels, lacing=Longest)  # create rooms from center points at Level; unwired: Point_List
watch_2 = Watch(createRoomAtPointAndLevel)
copy_element_to_location = Custom[Copy element to location]()  # This node will copy level-hosted elements to the given locations and rehost to the nearest level.(does not work for curve based elements); unwired: Element, Location
copyFromLinkInstance = Custom[Springs.Doc.CopyFromLinkInstance](LinkInstance=links, element=linkedInstanceElements.elements)  # The node will use the total transformation of the link instance to copy the input elements into the local document.
