# Dynamo graph Delete all Filter.dyn (Dynamo 2.13.1.3887)
# packages: archi-lab.net 2024.217.1024

element_types = ElementTypes("ParameterFilterElement")  # graph input
all_elements_of_type = ElementsOfType(element_class=element_types)
name = Element.Name(element=all_elements_of_type)
delete = archilab.Revit.Elements.Elements.Delete(element=name)
