# Dynamo graph Export IFC with Excel.dyn (Dynamo 2.13.1.3887)
# packages: Genius Loci 2023.7.13, Crumple 2022.5.27, Zhukoven.com 2021.2.27

file_path = Filename("Check\Export data.xlsx")
string = StringInput("IFC Exports")
excel_import = Custom[© Excel.Import](filePath=file_path, sheetName=string)  # package Crumple; Imports a 2D matrix of data from an existing Excel file path from a given worksheet name. If a worksheet does not exist by that name it will take the data from the first worksheet instead. Credit to Cyril Poupin for most of the Python code (details in node body).
restOfItems = List.RestOfItems(list=excel_import.dataRows)
transpose = List.Transpose(lists=restOfItems@L3)
code_block = CodeBlock { 1; }
flatten = List.Flatten(list=transpose, amount=code_block)
codeblock = CodeBlock(value=flatten) { value[0]; value[1]; value[2]; value[3]; value[4]; value[5]; value[6]; }
string_2 = StringInput("\")
code_block_2 = CodeBlock(Directory=codeblock.out0, n=string_2, Filename=codeblock.out1) { Directory+n+Filename+".RVT"; }
open = Custom[Document.Open](FilePath=code_block_2)  # package Zhukoven.com; Open document from the input File Path
string_to_directory = Python(IN[0]=codeblock.out6)  # CPython3
# ---------- string_to_directory.python (16 lines) ----------
# Enable Operating System functionalities
import os

# Function to convert a list of strings to directories
def strings_to_directories(directory_strings):
    try:
        directory_paths = [os.path.normpath(directory_string) for directory_string in directory_strings]
        return directory_paths
    except Exception as e:
        return [str(e)]

# The input list of strings to convert
i = IN[0]

# Call the function with the input list
OUT = strings_to_directories(i)
# ----------------------------------------
boolean = BoolSelector(true)
view_byname = Custom[View ByName](ViewName=codeblock.out3@L1, DoesContain=boolean, docOrRevitLinkInstance=open@L1)  # package Genius Loci; Collect views by given name in the active or given document. Based on a Christian Gartland's script.
string_from_object = FromObject(object=codeblock.out4)
export_ifc_in_document = Custom[Export IFC in Document](document=open, DirectoryPath=string_to_directory, view=view_byname, Filename=codeblock.out2, IFCversion=codeblock.out5, ProjectOrigin=string_from_object, lacing=Longest)  # package Genius Loci; Export Views to IFC file from document. The Project Origin option works only with Revit 2018 and above. Some other IFC options are embedded inside the python script.
