# Dynamo graph Export NWC with several documents.dyn (Dynamo 2.13.1.3887)
# packages: Genius Loci 2023.7.13, Rhythm 2023.9.1, Zhukoven.com 2021.2.27

revit_directory_path = Directory("D:\Thiru Manage\COG")
directory_from_path = DirectoryObject(path=revit_directory_path)
string = StringInput("*.rvt")
getDirectoryContents = FileSystem.GetDirectoryContents(directory=directory_from_path, searchString=string)
open = Custom[Document.Open](FilePath=getDirectoryContents.files)  # package Zhukoven.com; Open document from the input File Path
navis_directory_path = Directory("D:\Thiru Manage\Dynamo\Check\Exports")
enter_3d_view_name = StringInput("{3D}")
boolean = BoolSelector(true)
view_byname = Custom[View ByName](ViewName=enter_3d_view_name, DoesContain=boolean, docOrRevitLinkInstance=open)  # package Genius Loci; Collect views by given name in the active or given document. Based on a Christian Gartland's script.
geniusloci_documents_properties = Custom[GeniusLoci_Documents Properties](docOrRevitLinkInstance=open)  # package Genius Loci; Queries the document properties. Works also with familyDocument
geniusloci_enumerate_naviswork = Custom[GeniusLoci_Enumerate Naviswork Coordinates and Exportscope]()  # package Genius Loci; Use with the "Export NWC in Document" node.
export_scope_and_coordinates = CodeBlock(x=geniusloci_enumerate_naviswork.ExportScope, y=geniusloci_enumerate_naviswork.ChooseCoordinates) { x[1]; y[0]; }
export_revit_links = BoolSelector(true)
boolean_2 = BoolSelector(true)
geniusloci_export_nwc_in = Custom[GeniusLoci_Export NWC in Document](document=open, DirectoryPath=navis_directory_path, view=view_byname, Filename=geniusloci_documents_properties.FileName, exportScope=export_scope_and_coordinates.out0, chooseCoordinates=export_scope_and_coordinates.out1, ExportLinks=export_revit_links, RunIt=boolean_2, lacing=Longest)  # package Genius Loci; !! This node needs Navisworks Exporters for Revit to export NWC. This node exports Views to NWC files in the active or given document. Navisworks options are embedded inside the python script.
code_block = CodeBlock { false; }
ʳʰʸᵗʰᵐ_applications = Rhythm.Revit.Application.Applications.CloseDocument(document=geniusloci_export_nwc_in.Document, save=code_block)
