# Dynamo graph Filter GM-CT-CF.dyn (Dynamo 2.13.1.3887)

code_block = CodeBlock { 2..8; }
code_block_2 = CodeBlock(a=code_block) { FN = "S18-HZ00"+a+".001"; }
code_block_3 = CodeBlock { 11..48; }
code_block_4 = CodeBlock(a=code_block_3) { FN = "S18-HZ0"+a+".001"; }
join = List.Join(list0=code_block_2, list1=code_block_4)
code_block_5 = CodeBlock(l=join) { FN = l+"-GM"; }
categories = Categories("OST_GenericModel")
select_rule_type = RuleTypes("NotContains")
select_model_element = DSModelElementSelection()  # 1 picked in the model
parameters = Element.Parameters(element=select_model_element)
string_from_object = FromObject(object=parameters)
code_block_6 = CodeBlock { "Master_PR Module ID"; 26; }
contains = String.Contains(string=string_from_object@L1, searchFor=code_block_6.out0)
filterByBoolMask = List.FilterByBoolMask(list=parameters, mask=contains)
byRuleType = Revit.Filter.FilterRule.ByRuleType(type=select_rule_type, value=join, parameter=filterByBoolMask.in, lacing=CrossProduct)
byRules = Revit.Filter.ParameterFilterElement.ByRules(name=code_block_5, categories=categories, rules=byRuleType)
code_block_7 = CodeBlock { 2..8; }
code_block_8 = CodeBlock(a=code_block_7) { FN = "S18-HZ00"+a+".001"; }
code_block_9 = CodeBlock { 11..48; }
code_block_10 = CodeBlock(a=code_block_9) { FN = "S18-HZ0"+a+".001"; }
join_2 = List.Join(list0=code_block_8, list1=code_block_10)
code_block_11 = CodeBlock(l=join_2) { FN = l+"-CT"; }
categories_2 = Categories("OST_CableTrayFitting")
categories_3 = Categories("OST_CableTray")
join_3 = List.Join(list0=categories_2, list1=categories_3)
select_rule_type_2 = RuleTypes("NotContains")
select_model_element_2 = DSModelElementSelection()  # 1 picked in the model
parameters_2 = Element.Parameters(element=select_model_element_2)
string_from_object_2 = FromObject(object=parameters_2)
code_block_12 = CodeBlock { "Master_PR Module ID"; 26; }
contains_2 = String.Contains(string=string_from_object_2@L1, searchFor=code_block_12.out0)
filterByBoolMask_2 = List.FilterByBoolMask(list=parameters_2, mask=contains_2)
byRuleType_2 = Revit.Filter.FilterRule.ByRuleType(type=select_rule_type_2, value=join_2, parameter=filterByBoolMask_2.in, lacing=CrossProduct)
byRules_2 = Revit.Filter.ParameterFilterElement.ByRules(name=code_block_11, categories=join_3, rules=byRuleType_2)
code_block_13 = CodeBlock { 2..8; }
code_block_14 = CodeBlock(a=code_block_13) { FN = "S18-HZ00"+a+".001"; }
code_block_15 = CodeBlock { 11..48; }
code_block_16 = CodeBlock(a=code_block_15) { FN = "S18-HZ0"+a+".001"; }
join_4 = List.Join(list0=code_block_14, list1=code_block_16)
code_block_17 = CodeBlock(l=join_4) { FN = l+"-CF"; }
categories_4 = Categories("OST_CableTrayFitting")
select_rule_type_3 = RuleTypes("NotContains")
select_model_element_3 = DSModelElementSelection()  # 1 picked in the model
parameters_3 = Element.Parameters(element=select_model_element_3)
string_from_object_3 = FromObject(object=parameters_3)
code_block_18 = CodeBlock { "Master_PR Module ID"; 26; }
contains_3 = String.Contains(string=string_from_object_3@L1, searchFor=code_block_18.out0)
filterByBoolMask_3 = List.FilterByBoolMask(list=parameters_3, mask=contains_3)
byRuleType_3 = Revit.Filter.FilterRule.ByRuleType(type=select_rule_type_3, value=join_4, parameter=filterByBoolMask_3.in, lacing=CrossProduct)
byRules_3 = Revit.Filter.ParameterFilterElement.ByRules(name=code_block_17, categories=categories_4, rules=byRuleType_3)  # frozen
