# Dynamo graph Find parameter value Element.dyn (Dynamo 2.13.1.3887)

categories = Categories("OST_Furniture")
all_elements_of_category = ElementsOfCategory(Category=categories)
code_block = CodeBlock { "Mark"; "Comments"; }
getParameterValueByName = Element.GetParameterValueByName(element=all_elements_of_category, parameterName=code_block.out0)
code_block_2 = CodeBlock { 01..07; }
code_block_3 = CodeBlock(a=code_block_2) { "P0"+a; }
indexOf = List.IndexOf(list=getParameterValueByName, element=code_block_3)
getItemAtIndex = List.GetItemAtIndex(list=all_elements_of_category, index=indexOf)
setParameterByName = Element.SetParameterByName(element=getItemAtIndex, parameterName=code_block.out1, value=code_block_3)
