# Dynamo graph Home.dyn (Dynamo 2.13.1.3887)
# packages: spring nodes 210.1.1

ꟿ_form_bygeometry = Custom[ꟿ Form.ByGeometry]()  # package spring nodes; Convert the input geometry to a Revit Form object. Forms can exist only in the family environment. You can convert complicated solids or surfaces directly into forms. A form can act as a void. Provide either one true boolean value to convert a form into a void. The node's lacing is set to longest by default.; unwired: geometry
select_model_element = DSModelElementSelection()  # 1 picked in the model
geometry = Element.Geometry(element=select_model_element)
boolean = BoolSelector(true)
