# Dynamo graph Place Family by Solid Centroid.dyn (Dynamo 2.13.1.3887)
# packages: Genius Loci 2023.7.13

family_types = FamilyTypes("COG Point:COG Point")
select_model_elements = DSModelElementsSelection()  # 4 picked in the model
geometry = Element.Geometry(element=select_model_elements)
flatten = List.Flatten(list=geometry)
centroid = Solid.Centroid(solid=flatten)
byPoint = FamilyInstance.ByPoint(familyType=family_types, point=centroid)
code_block = CodeBlock { 1; }
chop = List.Chop(list=byPoint, lengths=code_block)
element_parameters_properties = Custom[Element Parameters Properties](element=select_model_elements@L2)  # package Genius Loci; Retrieves all the properties of the parameters from a given element in the active or given document.
filterByBoolMask = List.FilterByBoolMask(list=element_parameters_properties.Name, mask=element_parameters_properties.IsSharedParameter)
flatten_2 = List.Flatten(list=filterByBoolMask.in)
flatten_3 = List.Flatten(list=flatten_2)
getParameterValueByName = Element.GetParameterValueByName(element=select_model_elements@L1, parameterName=flatten_2)
setParameterByName = Element.SetParameterByName(element=chop@L1, parameterName=flatten_3, value=getParameterValueByName@L2)
