# Dynamo graph Sheet Apply View Temp.dyn (Dynamo 2.13.1.3887)
# packages: archi-lab.net 2024.217.1024, Crumple 2022.5.27

categories = Categories("OST_Sheets")
all_elements_of_category = ElementsOfCategory(Category=categories)
sheetName = Sheet.SheetName(sheet=all_elements_of_category)
string = StringInput("OVERALL")
code_block = CodeBlock(Strlist=sheetName, strings=string, Element1=all_elements_of_category)
# ---------- code_block.designscript (3 lines) ----------
bool1 = DSCore.String.Contains(Strlist, strings, false);
t1 = List.FilterByBoolMask(Element1, bool1);
t2 = Dictionary.ValueAtKey(t1, "in");
# ----------------------------------------
views = Sheet.Views(sheet=code_block.t2)
flatten = List.Flatten(list=views)
string_2 = StringInput("Title on Sheet")
getParameterValueByName = Element.GetParameterValueByName(element=flatten, parameterName=string_2, lacing=CrossProduct)
code_block_2 = CodeBlock { "ISOMETRIC VIEW"; "TOP VIEW"; "FRONT VIEW"; "SIDE VIEW"; }
code_block_3 = CodeBlock(Strlist=getParameterValueByName, strings=code_block_2.out1, Element1=flatten)  # same code as code_block
view_templates = ViewTemplatesUi("Plan View")
setViewTemplate = archilab.Revit.Views.Views.SetViewTemplate(view=code_block_3.t2, viewTemplate=view_templates)
code_block_4 = CodeBlock(Strlist=getParameterValueByName, strings=code_block_2.out2, Element1=flatten)  # same code as code_block
view_templates_2 = ViewTemplatesUi("S18-33 SECTION VIEW")
setViewTemplate_2 = archilab.Revit.Views.Views.SetViewTemplate(view=code_block_4.t2, viewTemplate=view_templates_2)
code_block_5 = CodeBlock(Strlist=getParameterValueByName, strings=code_block_2.out3, Element1=flatten)  # same code as code_block
view_templates_3 = ViewTemplatesUi("S18-33 SECTION VIEW")
setViewTemplate_3 = archilab.Revit.Views.Views.SetViewTemplate(view=code_block_5.t2, viewTemplate=view_templates_3)
code_block_6 = CodeBlock(Strlist=getParameterValueByName, strings=code_block_2.out0, Element1=flatten)  # same code as code_block
string_3 = StringInput("3D View")
views_applytemplatebyname = Custom[© Views.ApplyTemplateByName](views=code_block_6.t2, templateName=string_3)  # package Crumple; Given a list of views and a view template name, attempts to find and apply that template. Unlike Dynamo nodes, this process also works with 3D view templates as it runs within Python entirely.
string_4 = StringInput("CABLE BUS")
code_block_7 = CodeBlock(Strlist=sheetName, strings=string_4, Element1=all_elements_of_category)  # same code as code_block
views_2 = Sheet.Views(sheet=code_block_7.t2)
flatten_2 = List.Flatten(list=views_2)
getParameterValueByName_2 = Element.GetParameterValueByName(element=flatten_2, parameterName=string_2, lacing=CrossProduct)
code_block_8 = CodeBlock { "ISOMETRIC VIEW"; "TOP VIEW"; "FRONT VIEW"; "SIDE VIEW"; }
code_block_9 = CodeBlock(Strlist=getParameterValueByName_2, strings=code_block_8.out2, Element1=flatten_2)  # same code as code_block
view_templates_4 = ViewTemplatesUi("S18-33 SECTION VIEW")
setViewTemplate_4 = archilab.Revit.Views.Views.SetViewTemplate(view=code_block_9.t2, viewTemplate=view_templates_4)
code_block_10 = CodeBlock(Strlist=getParameterValueByName_2, strings=code_block_8.out3, Element1=flatten_2)  # same code as code_block
view_templates_5 = ViewTemplatesUi("S18 Side view Cable Bus")
setViewTemplate_5 = archilab.Revit.Views.Views.SetViewTemplate(view=code_block_10.t2, viewTemplate=view_templates_5)
code_block_11 = CodeBlock(Strlist=getParameterValueByName_2, strings=code_block_8.out0, Element1=flatten_2)  # same code as code_block
view_templates_6 = ViewTemplatesUi("Plan View-Cable Bus")
setViewTemplate_6 = archilab.Revit.Views.Views.SetViewTemplate(view=code_block_11.t2, viewTemplate=view_templates_6)
code_block_12 = CodeBlock(Strlist=getParameterValueByName_2, strings=code_block_8.out1, Element1=flatten_2)  # same code as code_block
string_5 = StringInput("3D View-Cable Bus")
views_applytemplatebyname_2 = Custom[© Views.ApplyTemplateByName](views=code_block_12.t2, templateName=string_5)
