# Dynamo graph Workset Element.dyn (Dynamo 2.13.1.3887)
# packages: archi-lab.net 2023.213.1722, Crumple 2022.5.27

code_block = CodeBlock { 1; }
boolean = BoolSelector(false)
file_path = Filename("C:\Users\thiruvarasan.k\Documents\worset data.xlsx")
string = StringInput("Sheet1")
worksets = WorksetUi("PF - Wet Fire")
byWorkset = archilab.Revit.Selection.Select.ByWorkset(workset=worksets)
name = Element.Name(element=byWorkset)
elementType = Element.ElementType(element=byWorkset)
uniqueItems = List.UniqueItems(list=elementType)
getCategory = Element.GetCategory(element=byWorkset)
uniqueItems_2 = List.UniqueItems(list=getCategory)
list_create = List.Create(item0=name, item1=elementType, item2=uniqueItems, item3=getCategory, item4=uniqueItems_2)
string_from_object = FromObject(object=list_create)
transpose = List.Transpose(lists=string_from_object)
excel_exporttofile = Custom[© Excel.ExportToFile](filePath=file_path, sheetName=string, dataRows=transpose)  # package Crumple; Exports a 2D matrix of data to an existing file path (if you provide a file path without a file it will write a new one). The node automatically adds a xlsx extension to the name. Credit to Cyril Poupin for most of the Python code (details in node body).
