# Dynamo graph Delete Parameter by list.dyn (Dynamo 2.0.4.12684)

# note: Data-Shapes v.2019.2.40
# Orchid v. 204.1.4.7584
# Clockwork v.2.3.0
boolean = BoolSelector(true)
# note: Custom Node: Clockwork v.2.3.0
projectParameters = Custom[Document.ProjectParameters](toggle=boolean)  # Retrieves all project parameters and the categories they have been assigned to
watch = Watch(projectParameters.paramName)
# note: Custom Node: Data-Shapes v.2019.2.40
ui_listview_data = Custom[UI.Listview Data](Keys=watch, Values=watch)  # Create data for ListView input in UI.MultiInputForm ++ . Check out www.data-shapes.net for more infos.
boolean_2 = BoolSelector(true)
ui_multipleinputform = Custom[UI.MultipleInputForm ++](Inputs=ui_listview_data, Toggle=boolean_2)  # Create a form with multiple inputs. see www.data-shapes.net for tutorials and infos!
# note: Custom Node: Orchid v. 204.1.4.7584
delete = Orchid.RevitProject.Parameters.Parameter.Delete(parameterName=ui_multipleinputform.User_Inputs)
