# Dynamo graph ElementRoom.Name.dyn (Dynamo 1.2.1.3083)

categories = Categories("GenericModel")
all_elements_of_category = ElementsOfCategory(categories)
element_get_location_in_room = Custom[Element.Get Location in Room](Element=all_elements_of_category)  # Obtenir la localisation "dans Pièce" des éléments (MyBIMtheque)
code_block = CodeBlock { "AMCS Room Name"; }
code_block_2 = CodeBlock { "Name"; }
getParameterAsValueString = Custom[GetParameterAsValueString](Elements=element_get_location_in_room, ParameterName=code_block_2)  # Returns the parameter values without conversion to the revit internal unit system. The suffix boolean toggles the project units on or off
setParameterByName = Element.SetParameterByName(element=element_get_location_in_room, parameterName=code_block, value=getParameterAsValueString)
code_block_3 = CodeBlock { "Level"; }
getParameterAsValueString_2 = Custom[GetParameterAsValueString](Elements=all_elements_of_category, ParameterName=code_block_3@L1)
flatten = Flatten(getParameterAsValueString_2)
duplicateItemIndicies = archilab.Lists.Lists.DuplicateItemIndicies(getParameterAsValueString_2@@L2)
flatten_2 = Flatten(duplicateItemIndicies)
uniqueItems = List.UniqueItems(flatten_2)
getItemAtIndex = List.GetItemAtIndex(list=flatten, index=uniqueItems)
getLevelByName = archilab.Revit.Selection.Select.GetLevelByName(getItemAtIndex)
setParameterByName_2 = Element.SetParameterByName(element=all_elements_of_category, parameterName=code_block, value=getParameterAsValueString)
code_block_4 = CodeBlock { "AMCS Room Number"; }
code_block_5 = CodeBlock { "Number"; }
getParameterAsValueString_3 = Custom[GetParameterAsValueString](Elements=element_get_location_in_room, ParameterName=code_block_5)
setParameterByName_3 = Element.SetParameterByName(element=all_elements_of_category, parameterName=code_block_4, value=getParameterAsValueString_3)
setParameterByName_4 = Element.SetParameterByName(element=element_get_location_in_room, parameterName=code_block_4, value=getParameterAsValueString_3)
