# Dynamo graph Elevation Maker by Excel and offset.dyn (Dynamo 2.0.3.8810)

categories = Categories(index=192)
byCategory = Orchid.RevitProject.Elements.Family.ByCategory(category=categories)
file_path = Filename("Ground Floor\b3\View List Copy 1 - Copy.xlsx")
file_from_path = FileObject(path=file_path)
code_block = CodeBlock { "RoomName"; }
boolean = BoolSelector(true)
boolean_2 = BoolSelector(true)
importExcel = Data.ImportExcel(file=file_from_path, sheetName=code_block, readAsStrings=boolean, showExcel=boolean_2)
transpose = List.Transpose(lists=importExcel)
code_block_2 = CodeBlock(l=transpose) { l[0]; l[1]; }
get_rooms_by_name_or_number = Custom[Get rooms by name or number](NameOrNumber=code_block_2.out0, Refresh=code_block_2.out1)  # Enter the room name or number to get the room. Inspired by jeremy@learndynamo.com
select_model_element = DSModelElementSelection()  # 1 picked in the model
categories_2 = Categories(index=425)
all_elements_of_category = ElementsOfCategory(Category=categories_2)
code_block_3 = CodeBlock { "Center"; "MinWithOffset"; }
join = List.Join(list0=code_block_3.out0, list1=code_block_3.out1)
code_block_4 = CodeBlock { "G-102C-034"; }
get_rooms_by_name_or_number_2 = Custom[Get rooms by name or number](NameOrNumber=code_block_4)
room_or_space_reset_center = Custom[Room or Space reset center location](Rooms_Spaces=get_rooms_by_name_or_number_2.Rooms)  # This node will attempt to reset the location of the room or space to its default center location
finishBoundary = Room.FinishBoundary(room=get_rooms_by_name_or_number_2.Rooms)
as_polycurve_bycurves = Custom[AS.[&] PolyCurve.ByCurves](VARcurves=finishBoundary)  # Create polycurves from an unordered list of curves.
ꟿ_polycurve_points = Custom[ꟿ PolyCurve.Points](polyCurve=as_polycurve_bycurves)  # Gets all the unique start and end points of the underlying curves in a sorted list.
code_block_5 = CodeBlock { 2; }
flatten = List.Flatten(list=ꟿ_polycurve_points, amt=code_block_5)
index = Custom[LeastPoint.Index](Points_var_var=flatten@L2)  # Least point of the list
number = DoubleInput(1200)  # graph input
code_block_6 = CodeBlock(point1=index.point, Offsets=number)
# ---------- code_block_6.designscript (7 lines) ----------
t1 = Autodesk.Point.X(point1);
t2 = Autodesk.Point.Y(point1);
t3 = Autodesk.Point.Z(point1);
offestx = t1+Offsets;
offesty = t2+Offsets;

point2 = Autodesk.Point.ByCoordinates(offestx,offesty,t3);
# ----------------------------------------
list_create = List.Create(item0=room_or_space_reset_center.Locations, item1=code_block_6.point2)
radiobuttons_data = Custom[RadioButtons Data](Keys=join, Values=list_create@L3)  # Create radio buttons input for UI.MultipleInputForm ++ .
boolean_3 = BoolSelector(true)
multipleinputform = Custom[MultipleInputForm ++](Inputs=radiobuttons_data, Toggle=boolean_3)  # Create a form with multiple inputs. see www.data-shapes.net for tutorials and infos!
code_block_7 = CodeBlock { 100; }
viewFamilyTypes = ViewFamilyTypes(index=8)
ʳʰʸᵗʰᵐ_elevationmarker = Rhythm.Revit.Elements.ElevationMarker.CreateElevationMarker(location=multipleinputform.User_Inputs, scaleFactor=code_block_7, viewFamilyType=viewFamilyTypes)
levels = Levels(index=0)  # graph input
byLevel = FloorPlanView.ByLevel(level=levels)
code_block_8 = CodeBlock { 0..3; }
ʳʰʸᵗʰᵐ_elevationmarker_2 = Rhythm.Revit.Elements.ElevationMarker.CreateElevationByMarkerIndex(elevationMarker=ʳʰʸᵗʰᵐ_elevationmarker, planView=byLevel, index=code_block_8@L2)
view_templates = ViewTemplate(index=10)
setViewTemplate = archilab.Revit.Views.Views.SetViewTemplate(view=ʳʰʸᵗʰᵐ_elevationmarker_2@L1, viewTemplate=view_templates)
