# Dynamo graph Elevation Maker by Excel and offset_fail.dyn (Dynamo 2.0.3.8810)

categories = Categories(index=192)
byCategory = Orchid.RevitProject.Elements.Family.ByCategory(category=categories)
select_model_element = DSModelElementSelection()  # 1 picked in the model
byCorners = BoundingBox.ByCorners()
ʳʰʸᵗʰᵐ_view_setcropregion = Rhythm.Revit.Views.View.SetCropRegion(bBox=byCorners)  # unwired: view
cropBox = archilab.Revit.Views.Views.CropBox()  # frozen; unwired: view
maxPoint = BoundingBox.MaxPoint(boundingBox=cropBox)
translate = Geometry.Translate(geometry=maxPoint)  # unwired: direction, distance
minPoint = BoundingBox.MinPoint(boundingBox=cropBox)
ZAxis = Vector.ZAxis()
reverse = Vector.Reverse(vector=ZAxis)
code_block = CodeBlock { 50; }
translate_2 = Geometry.Translate(geometry=minPoint, direction=reverse, distance=code_block)
reverse_2 = Vector.Reverse()  # unwired: vector
translate_3 = Geometry.Translate(geometry=translate_2, direction=reverse_2)  # unwired: distance
file_path = Filename("\\server2\Public Share\Thiru\MEQ MODEL\Room Schedule.xlsx")
code_block_2 = CodeBlock { "New Views"; 0; }
file_path_2 = Filename("\\server2\Public Share\Thiru\MEQ MODEL\Room Schedule.xlsx")
file_from_path = FileObject(path=file_path_2)
code_block_3 = CodeBlock { "Room Data"; }
boolean = BoolSelector(true)
boolean_2 = BoolSelector(true)
importExcel = Data.ImportExcel(file=file_from_path, sheetName=code_block_3, readAsStrings=boolean, showExcel=boolean_2)
transpose = List.Transpose(lists=importExcel)
code_block_4 = CodeBlock(l=transpose) { l[0]; }
boolean_3 = BoolSelector(true)
get_rooms_by_name_or_number = Custom[Get rooms by name or number](NameOrNumber=code_block_4@L1, Refresh=boolean_3)  # Enter the room name or number to get the room. Inspired by jeremy@learndynamo.com
code_block_5 = CodeBlock { 0.2; "PLAN"; }
boolean_4 = BoolSelector(true)
byRoom = Custom[FloorPlan.ByRoom](room=get_rooms_by_name_or_number.Rooms, prefix=code_block_5.out1, offset=code_block_5.out0, runIt=boolean_4)  # This node takes input of a Room and creates a Floor Plan View with Crop Box set around that room.
flatten = List.Flatten(list=byRoom)
name = Element.Name(element=flatten)
location = Room.Location(room=get_rooms_by_name_or_number.Rooms)
code_block_6 = CodeBlock { 20; }
viewFamilyTypes = ViewFamilyTypes(index=8)
ʳʰʸᵗʰᵐ_elevationmarker = Rhythm.Revit.Elements.ElevationMarker.CreateElevationMarker(location=location, scaleFactor=code_block_6, viewFamilyType=viewFamilyTypes)
byLevel = FloorPlanView.ByLevel(level=get_rooms_by_name_or_number.Levels)
code_block_7 = CodeBlock { 0..3; }
ʳʰʸᵗʰᵐ_elevationmarker_2 = Rhythm.Revit.Elements.ElevationMarker.CreateElevationByMarkerIndex(elevationMarker=ʳʰʸᵗʰᵐ_elevationmarker, planView=byLevel, index=code_block_7@L2)
view_templates = ViewTemplate(index=10)
setViewTemplate = archilab.Revit.Views.Views.SetViewTemplate(view=ʳʰʸᵗʰᵐ_elevationmarker_2@L1, viewTemplate=view_templates)
name_2 = Element.Name(element=setViewTemplate)
list_create = List.Create(item0=name, item1=name_2)
transpose_2 = List.Transpose(lists=list_create)
boolean_5 = BoolSelector(false)
exportExcel = Data.ExportExcel(filePath=file_path, sheetName=code_block_2.out0, startRow=code_block_2.out1, startCol=code_block_2.out1, data=transpose_2, overWrite=boolean_5)
getCropBoxCurves = Custom[View.GetCropBoxCurves](views=setViewTemplate)  # frozen; returns the curves of a view crop box, even irregular shapes. Returns an empty list if the crop view is not active for a given view
code_block_8 = CodeBlock { 0.5; }
ꟿ_closedcurve_offset = Custom[ꟿ ClosedCurve.Offset+](curve=getCropBoxCurves, distance=code_block_8)  # Offsets a curve both ways and correctly differenciates the external and internal offset. If an offset goes beyond the curve's bounds, the result will fail and a null value will be appended instead. Also works for convex curves like arcs.
setCropBoxByCurves = archilab.Revit.Views.Views.SetCropBoxByCurves(view=setViewTemplate, curves=ꟿ_closedcurve_offset.external_offset)
view_templates_2 = ViewTemplate(index=1)
setViewTemplate_2 = archilab.Revit.Views.Views.SetViewTemplate(view=byRoom@L1, viewTemplate=view_templates_2)
name_3 = Element.Name(element=get_rooms_by_name_or_number.Rooms)
code_block_9 = CodeBlock(a=name_3, b=name_2) { a+b; }
setName = archilab.Revit.Views.Views.SetName(view=setViewTemplate, name=code_block_9)
