# Dynamo graph Equipment Parameter Update.dyn "Cobie Element Room Name" (Dynamo 2.0.4.12684)

file_path = Filename("..\..\..\..\Revit API\02_Reference\Brown ii Logo.png")
string = StringInput("Proceed")
# note: Custom Node: Data-Shapes v.2019.2.40
# note: Auth : @thiru52k
# Packages used
# Data-Shapes v.2019.2.40
# Clockwork v.2.3.0
# archilab v.2020.23.9
categories_list = Custom[Categories list]()  # Gives list of all Revit categories and a matching list of their names
# note: Custom Node: Clockwork v.2.3.0
type = Custom[Category.Type](category=categories_list.Revit_Categories)  # Returns the type of the category
code_block = CodeBlock(l=type) { l[1]; }
contains = List.Contains(list=type@L1, item=code_block)
filterByBoolMask = List.FilterByBoolMask(list=categories_list.Category_name_s, mask=contains)
ui_listview_data = Custom[UI.Listview Data](Keys=filterByBoolMask.in, Values=filterByBoolMask.in)  # Create data for ListView input in UI.MultiInputForm ++ . Check out www.data-shapes.net for more infos.
boolean = BoolSelector(true)
string_2 = StringInput("Cancel")
code_block_2 = CodeBlock { 500; 300; }
ui_multipleinputform = Custom[UI.MultipleInputForm ++](Logo_optional=file_path, ButtonText_optional=string, Inputs=ui_listview_data, Toggle=boolean, CancelButtonText_optional=string_2, MaxHeight_optional=code_block_2.out0, Width_optional=code_block_2.out1)  # Create a form with multiple inputs. see www.data-shapes.net for tutorials and infos!
categorie_s_by_enu_name_s = Custom[Categorie(s) by ENU Name(s)](CategoryNameInEnglish=ui_multipleinputform.User_Inputs)  # Gets categorie(s) in the current UI language by it's english name
all_elements_of_category = ElementsOfCategory(Category=categorie_s_by_enu_name_s.Categorie_s)
flatten = List.Flatten(list=all_elements_of_category)
string_3 = StringInput("COBie.Component.Space")
string_4 = StringInput("ELEM_ROOM_NAME")
# note: Custom Node: archilab v.2020.23.9
get_built_in_parameter = Custom[Get Built In Parameter](parameterNames=string_4, elements=flatten)  # This node will take an input of a built in parameter name and element to return that parameters value.
setParameterByName = Element.SetParameterByName(element=flatten, parameterName=string_3, value=get_built_in_parameter)
