# Dynamo graph Excel to reference point.dyn (Dynamo 1.2.1.3083)

file_path = Filename("C:\Users\Z440\Desktop\40.xlsx")
fromPath = FileObject(file_path)  # "File.FromPath"
code_block = CodeBlock { "Sheet1"; }
boolean = BoolSelector(false)
readFromFile = Excel.ReadFromFile(file=fromPath, sheetName=code_block, readAsStrings=boolean)
transpose = List.Transpose(readFromFile)
code_block_2 = CodeBlock(l=transpose) { l[0]; }
code_block_3 = CodeBlock(l=transpose) { l[1]; }
code_block_4 = CodeBlock(l=transpose) { l[2]; }
byCoordinates = Point.ByCoordinates(x=code_block_2, y=code_block_3, z=code_block_4)
byPoint = ReferencePoint.ByPoint(byCoordinates)
