# Dynamo graph Family Parameter Remover from Family.dyn (Dynamo 2.0.3.8810)

# note: Custom Node: Orchid v. 204.1.4.7626
# note: Orchid v. 204.1.4.7626
# Data-Shapes v.2021.2.92
current = Orchid.RevitProject.Common.Document.Current()
parameters = Orchid.RevitFamily.Document.Parameters(familyDocument=current)
# note: Custom Node: Data-Shapes v.2021.2.92
listview_data = Custom[Listview Data](Keys=parameters, Values=parameters)  # Create data for ListView input in UI.MultiInputForm ++ . Check out www.data-shapes.net for more infos.
boolean = BoolSelector(true)
multipleinputform = Custom[MultipleInputForm ++](Inputs=listview_data, Toggle=boolean)  # Create a form with multiple inputs. see www.data-shapes.net for tutorials and infos!
name = Orchid.RevitFamily.Parameter.Name(parameter=multipleinputform.User_Inputs)
delete = Orchid.RevitFamily.Parameter.Delete(familyDocument=current, parameterName=name)
