# Dynamo graph Family Place by Distance.dyn (Dynamo 1.2.1.3083)

# group: Select Family
family_types = FamilyTypes("Mount_trl_Right:1235_SL")

select_model_elements = DSModelElementsSelection()  # 510 picked in the model
point = ReferencePoint.Point(select_model_elements)
byPoints = PolyCurve.ByPoints(points=point)
startPoint = Curve.StartPoint(byPoints)

# group: Differnce Between one to another
distance = CodeBlock { 1.6; }

pointsAtChordLengthFromPoint = Curve.PointsAtChordLengthFromPoint(byPoints, startPoint, distance)
byPoint = FamilyInstance.ByPoint(familyType=family_types, point=pointsAtChordLengthFromPoint)
parameterAtPoint = Curve.ParameterAtPoint(curve=byPoints, point=pointsAtChordLengthFromPoint)
flatten = Flatten(parameterAtPoint)
tangentAtParameter = Curve.TangentAtParameter(byPoints, flatten, lacing=CrossProduct)
flatten_2 = Flatten(tangentAtParameter)

# group: Zhukoven.com package
getRotation = Custom[Element.GetRotation](InputVector=tangentAtParameter, Rotate90=flatten_2)  # This node calculates rotation angle between selected element's vector and Y axis. Vector Z is used as rotation axis. Use resulting degree as an input to the FamilyInstance.SetRotation node.

setRotation = FamilyInstance.SetRotation(familyInstance=byPoint, degree=getRotation)
