# Dynamo graph Family Spot Coordinate value.dyn (Dynamo 2.1.0.7500)

# group: Select existing Empty Excel sheet
file_path = Filename(".\data.xlsx")

string = StringInput("Sheet1")
code_block = CodeBlock { 1; }

# group: Select Family
family_types = FamilyTypes("palmtree4:palmtree4")

all_elements_of_family_type = ElementsOfFamilyType(Family_Type=family_types)
location = archilab.Revit.Elements.Elements.Location(element=all_elements_of_family_type)
python_script = Python(IN[0]=location.Point)
# ---------- python_script.python (47 lines) ----------
import clr
clr.AddReference('RevitServices')
import RevitServices 
from RevitServices.Persistence import DocumentManager
doc = DocumentManager.Instance.CurrentDBDocument

clr.AddReference('RevitNodes')
import Revit
clr.ImportExtensions(Revit.GeometryConversion)

clr.AddReference('RevitAPI')
import Autodesk
from Autodesk.Revit.DB import FilteredElementCollector, BuiltInCategory

# Create a list object from singleton...
def tolist(obj1):
	if hasattr(obj1,"__iter__"): return obj1
	else: return [obj1]
	
# Convert Point from  Internal to Shared Coordinates...
def ToSharedCoordinates(pt):
	pt = doc.ActiveProjectLocation.GetTotalTransform().Inverse.OfPoint(pt).ToPoint()
	return pt

# Convert Point from Relative to Project Coordinates...
def ToProjectCoordinates(pt,pbp):
	pt = pt.Subtract(pbp).ToPoint()
	return pt

# Input Variables...
pts = tolist(IN[0])
# Output Variables...
shared, project, relative = [], [], []

# Collect Project Basepoint...
basePt = FilteredElementCollector(doc).OfCategory(BuiltInCategory.OST_ProjectBasePoint).FirstElement()
pbp = basePt.get_BoundingBox(None).Min

for pt in pts:
	# Convert point to Shared Coordinates...
	shared.append(ToSharedCoordinates(pt.ToXyz()))
	# Convert point to Project Coordinates...
	project.append(ToProjectCoordinates(pt.ToXyz(),pbp))
	# Point is already Relative to the Internal Origin...
	relative.append(pt)
     
OUT = shared, project, relative
# ----------------------------------------
code_block_2 = CodeBlock(l=python_script) { SurveyPoints = l[0]; Projectbasepoints =l[1]; Originpoints=l[2]; }
flatten = List.Flatten(list=code_block_2.SurveyPoints)
code_block_3 = CodeBlock(t1=flatten) { t2 = Point.X(t1); t3 = Point.Y(t1); t4 = Point.Z(t1); }
list_create = List.Create(item0=code_block_3.t2, item1=code_block_3.t3, item2=code_block_3.t4)
transpose = List.Transpose(lists=list_create)
boolean = BoolSelector(true)
exportExcel = Data.ExportExcel(filePath=file_path, sheetName=string, startRow=code_block, startCol=code_block, data=transpose, overWrite=boolean)
