# Dynamo graph Level By Space.dyn (Dynamo 1.2.1.3083)

categories = Categories("MEPSpaces")
all_elements_of_category = ElementsOfCategory(categories)
levels = Levels("UL_TOS_UNDER PLATFORM LEVEL")
all_elements_at_level = ElementsAtLevel(levels)
id = Element.Id(all_elements_at_level)
id_2 = Element.Id(all_elements_of_category)
containsItem = List.ContainsItem(list=id, item=id_2)
filterByBoolMask = List.FilterByBoolMask(list=all_elements_of_category, mask=containsItem)
watch = Watch(filterByBoolMask.in)
uniqueItems = List.UniqueItems(filterByBoolMask.in)
