# Dynamo graph Parameter value change.dyn (Dynamo 2.0.4.12684)

categories = Categories(index=581)
all_elements_of_category = ElementsOfCategory(Category=categories)
levels = Levels(index=0)
# note: Custom Package: GeniusLoci v.2021.2.18
element_level = Custom[Element Level](element=all_elements_of_category)  # Gets an element's level. Based on a Clockwork's node
contains = List.Contains(list=levels, item=element_level@L1)
filterByBoolMask = List.FilterByBoolMask(list=all_elements_of_category, mask=contains)
parameter_name = StringInput("Mark")
prefix = StringInput("G")
getParameterValueByName = Element.GetParameterValueByName(element=filterByBoolMask.in, parameterName=parameter_name)
code_block = CodeBlock(a=prefix, b=getParameterValueByName) { a+b; }
setParameterByName = Element.SetParameterByName(element=filterByBoolMask.in, parameterName=parameter_name, value=code_block)
