# Dynamo graph Pipe Opening - revit 2020.dyn (Dynamo 2.1.0.7500)

# note: Script Name: Pipe Opening - revit 2020.dyn
# Packages used in this script:
# Bakery version: 2018.4.301
# Springs
# GeniusLoci
# TimeStamp : 2023/8/22 20:1
categories = Categories("OST_Walls")
all_elements_of_category = ElementsOfCategory(Category=categories)
categories_2 = Categories("OST_PipeCurves")
all_elements_of_category_2 = ElementsOfCategory(Category=categories_2)
bakery_revit_element_clash = Custom[Bakery_Revit Element Clash Detection v1](RevitElementSetA=all_elements_of_category, RevitElementSetB=all_elements_of_category_2)
# note: if Load family  from Library - Round Openning to change parameters Type  to instant of Rough Diameter, radius, Rough width and Rough Hight
opening_family = FamilyTypes("M_Opening-Window-Round:0300mm Diameter")
springs_ꟿ_familyinstance = Custom[Springs_ꟿ FamilyInstance.ByHostAndPoint](host=bakery_revit_element_clash.clashSetA, type=opening_family, point=bakery_revit_element_clash.clashPoint)  # Creates hosted family instances(doors/windows) at the specified points. You can feed either a single family type or a unique type for each instance.
pipe_tolerance = DoubleSlider(15, range=5..15 step 5)

# group: Opening Family Ajustment
string = StringInput("Elevation from Level")
string_2 = StringInput("Diameter")
getParameterValueByName = Element.GetParameterValueByName(element=bakery_revit_element_clash.clashSetB, parameterName=string_2)
code_block = CodeBlock(d=getParameterValueByName, i=pipe_tolerance) { d+i*2; }
string_3 = StringInput("Middle Elevation")
getParameterValueByName_2 = Element.GetParameterValueByName(element=bakery_revit_element_clash.clashSetB, parameterName=string_3)
code_block_2 = CodeBlock(a=code_block, b=getParameterValueByName_2) { c=(a*-1)/2; d=b+c; }
setParameterByName = Element.SetParameterByName(element=springs_ꟿ_familyinstance, parameterName=string, value=code_block_2.d)
string_4 = StringInput("Rough Diameter")
setParameterByName_2 = Element.SetParameterByName(element=springs_ꟿ_familyinstance, parameterName=string_4, value=code_block)

geniusloci_element_host = Custom[GeniusLoci_Element Host](element=springs_ꟿ_familyinstance)  # Gets the host of the element. Unlike the OOTB node FamilyInstance.GetHost, it also works for elements hosted by a linked document, wall sweeps, foundations, railings and builing pads. Based on a Clockwork's node
