# Dynamo graph Pipe Support by Dynamo.dyn (Dynamo 2.10.1.3976)
# packages: Genius Loci 2021.11.10, JeffMEP 0.1.1, Brown ii 2021.12.5, Zhukoven.com 2021.2.27, DynaMEP 1.2.8

# group: Select Support model and update parameter as per family
support_family = FamilyTypes("Pipe Support:Pipe Support")
family_parameter_for_suspention = StringInput("Suspension Height")  # "Family Parameter for Suspention Height"
family_parameter_for_radius = StringInput("Radius")
get_diameter_of_the_pipe = StringInput("Diameter")

reverse_placing = BoolSelector(false)

# group: Input From Pipe and Support Details
select_pipe = DSModelElementsSelection()  # 1 picked in the model
first_support_star_from = DoubleInput(1)  # "First Support Star from Connection"
support_distance_from_one_to = DoubleInput(1000)  # "Support Distance from one to another"
maximum_support_length_for = DoubleInput(4000)  # "Maximum Support Length for undefined Location"

# note: Custom Node: JeffMEP v.0.1.1
pipeCLCurve = Custom[PipeCLCurve](pipes=select_pipe)  # package JeffMEP; Gets the CL curve of the pipe
reverse = Curve.Reverse(curve=pipeCLCurve.curves)
if_ = If(test=reverse_placing, true=reverse, false=pipeCLCurve.curves)
approximateWithArcAndLineSegments = Curve.ApproximateWithArcAndLineSegments(curve=if_)
boolean = BoolSelector(true)
# note: Custom Node: Brown ii v.2021.12.5
curveStartPointsAtLength = Custom[Point.CurveStartPointsAtLength](Curves=approximateWithArcAndLineSegments, FirstPointDistace=first_support_star_from, ChorldLength=support_distance_from_one_to, Forward=boolean)  # package Brown ii; Use this node for Eg. Pipe Support start with distance and make chorld length with forward option and use as also Curve.PointsAtChordLengthFromPoint by forward false
levels = Levels("Level 1")
python_script = Python(IN[0]=support_family, IN[1]=curveStartPointsAtLength, IN[2]=levels)  # IronPython2
# ---------- python_script.python (39 lines) ----------
import clr
clr.AddReference("RevitServices")
clr.AddReference("RevitNodes")
import RevitServices
from RevitServices.Persistence import DocumentManager
from RevitServices.Transactions import TransactionManager
doc = DocumentManager.Instance.CurrentDBDocument
 
import Revit
clr.ImportExtensions(Revit.Elements)
clr.ImportExtensions(Revit.GeometryConversion)
 
clr.AddReference("RevitAPI")
from Autodesk.Revit.DB import *

# Import DSCore for Fatten
clr.AddReference('DSCoreNodes')
import DSCore
from DSCore import *




famType = UnwrapElement(IN[0])

if isinstance(IN[1],list): pts = DSCore.List.Flatten(IN[1],-1)
else: pts = IN[1]


lvl = UnwrapElement(IN[2])
 
elems = []
 
for pt in pts:
	 TransactionManager.Instance.EnsureInTransaction(doc)
 	 elems.append(doc.Create.NewFamilyInstance(pt.ToRevitType(True), famType, lvl, Structure.StructuralType.NonStructural))
	 TransactionManager.Instance.TransactionTaskDone()
	 
OUT = elems
# ----------------------------------------

# group: Select Linked STR Slab and Finish mulitiple selection
# note: Author : Thiruvarasan Kaliyaperumal
# Cont: thiru52k@gmail.com
# Ver : Revit 2021/Dynamo 2.10
# Used Packages:
# GeniusLoci v.2021.11.10
# JeffMEP v.0.1.1
# Brown ii v.2021.12.5
# Zhukoven v.2021.2.27
# DynaMEP v.1.2.8
boolean_2 = BoolSelector(true)
# note: Custom Node: GeniusLoci v.2021.11.10
select_linked_element = Custom[Select Linked Element](refresh=boolean_2)  # package Genius Loci; Selects the linked elements.
geometry = Element.Geometry(element=select_linked_element.Element)

flatten = List.Flatten(list=geometry)
byUnion = Solid.ByUnion(solids=flatten)
python_script_2 = Python(IN[0]=curveStartPointsAtLength, IN[1]=byUnion, IN[2]=maximum_support_length_for)  # IronPython2
# ---------- python_script_2.python (46 lines) ----------
# Load the Python Standard and DesignScript Libraries
import sys
import clr
clr.AddReference('ProtoGeometry')
from Autodesk.DesignScript.Geometry import *

# Import DSCore for Fatten
clr.AddReference('DSCoreNodes')
import DSCore
from DSCore import *


#Input Point
#ipoint = IN[0]
if isinstance(IN[0],list): ipoints = DSCore.List.Flatten(IN[0],-1)
else: ipoints = IN[0]

iline = IN[1]
maxlen = IN[2]
Avector = Vector.ZAxis();
Outpoints = []

#ittrate vectors and append intersect point
for ipoint in ipoints:
	#Dummy fisrt intersect check
	dline = Line.ByStartPointDirectionLength(ipoint,Avector,0.1)
	i = 2
	n = 0
	Outpoint = []
	while True:
			if Geometry.DoesIntersect(iline,dline):
				geointer = Geometry.Intersect(iline,dline)
				Outpoint.append(geointer)
				break
			elif n == maxlen:
			
				Poi = Point.ByCoordinates(ipoint.X,ipoint.Y,maxlen)
				line = Line.ByStartPointEndPoint(Poi,ipoint)
				Outpoint.append(line)
				break
			else:
				dline = Line.ByStartPointDirectionLength(ipoint,Avector,i)
				i = i+1
				n = n+1
	Outpoints.append(Outpoint)			
OUT = DSCore.List.Flatten(Outpoints,-1)
# ----------------------------------------
startPoint = Curve.StartPoint(curve=python_script_2)
byStartPointEndPoint = Line.ByStartPointEndPoint(startPoint=startPoint@L1, endPoint=curveStartPointsAtLength@L1)
length = Curve.Length(curve=byStartPointEndPoint)
code_block = CodeBlock { 4; }
round = Math.Round(number=length, digits=code_block)
setParameterByName = Element.SetParameterByName(element=python_script@L1, parameterName=family_parameter_for_suspention, value=round@L1)
getParameterValueByName = Element.GetParameterValueByName(element=select_pipe, parameterName=get_diameter_of_the_pipe)
code_block_2 = CodeBlock(a=getParameterValueByName) { a/2; }
setParameterByName_2 = Element.SetParameterByName(element=python_script, parameterName=family_parameter_for_radius, value=code_block_2)
startPoint_2 = Curve.StartPoint(curve=approximateWithArcAndLineSegments)
endPoint = Curve.EndPoint(curve=approximateWithArcAndLineSegments)
byTwoPoints = Vector.ByTwoPoints(start=startPoint_2@L1, end=endPoint@L1)
boolean_3 = BoolSelector(false)
# note: Custom Node: Zhukoven v.2021.2.27
getRotation = Custom[Element.GetRotation](InputVector=byTwoPoints, Rotate90=boolean_3)  # package Zhukoven.com; This node calculates rotation angle between selected element's vector and Y axis. Vector Z is used as rotation axis. Use resulting degree as an input to the FamilyInstance.SetRotation node.
# note: Custom Node: DynaMEP v.1.2.8
rotate = RevitModel.Element.Rotate(Element=python_script@L1, Exit=byTwoPoints, Degrees=getRotation)
