# Dynamo graph Raiser Floor Support as per Room.dyn (Dynamo 2.0.4.12684)

select_raiser_floor_family = FamilyTypes(index=168)

# group: Update as per your Project
# note: Author : Thiruvarasan
# thiru52k@gmail.com
# Synthesize v.6.7.1
# Ampersand v.2019.12.31
# archilab v.2020.23.9
categories = Categories(index=416)
all_elements_of_category = ElementsOfCategory(Category=categories)

# note: Custom Node: Synthesize v.6.7.1
boundaries = Custom[CW.Room.Boundaries](VARroom=all_elements_of_category)  # Gets a list of all boundary elements of a given room or area
flatten = List.Flatten(list=boundaries.VARcurves)
# note: Custom Node: Ampersand v.2019.12.31
polycurve_bycurves = Custom[[&] PolyCurve.ByCurves](curves=flatten)  # Create polycurves from an unordered list of curves.
byPatch = Surface.ByPatch(closedCurve=polycurve_bycurves)
python_script = Python(IN[0]=flatten)
# ---------- python_script.python (49 lines) ----------
import clr

clr.AddReference('RevitAPI')
from Autodesk.Revit.DB import *
from Autodesk.Revit.DB.Structure import *

clr.AddReference('RevitAPIUI')
from Autodesk.Revit.UI import *

clr.AddReference('System')
from System.Collections.Generic import List

clr.AddReference('RevitNodes')
import Revit
clr.ImportExtensions(Revit.GeometryConversion)
clr.ImportExtensions(Revit.Elements)

clr.AddReference('RevitServices')
import RevitServices
from RevitServices.Persistence import DocumentManager
from RevitServices.Transactions import TransactionManager

doc = DocumentManager.Instance.CurrentDBDocument
uidoc=DocumentManager.Instance.CurrentUIApplication.ActiveUIDocument


line = IN[0]
points = []
for i in line:
	lsp = i.StartPoint
	points.append(lsp)
xvalue = []
yvalue = []
for pt in points:
	xVal = pt.X
	yVal = pt.Y
	xvalue.append(xVal)
	yvalue.append(yVal)
	
Xmaxi = int(max(xvalue))
Ymayi = int(max(yvalue))
Xmini = int(min(xvalue))
Ymini = int(min(yvalue))

#maxCorner = Point.ByCoordinates(Xmaxi,Ymaxi,(points[0]).Z)
#minCorner = Point.ByCoordinates(Xmini,Ymini,(points[0]).Z)
#rec = Rectangle.ByCornerPoints(minCorner,maxCorner)

OUT = Xmaxi,Ymayi,Xmini,Ymini
# ----------------------------------------
code_block = CodeBlock(l=python_script) { l[0]; l[1]; l[2]; l[3]; }
byCoordinates = Point.ByCoordinates(x=code_block.out2, y=code_block.out3)
byCoordinates_2 = Point.ByCoordinates(x=code_block.out0, y=code_block.out3)
byCoordinates_3 = Point.ByCoordinates(x=code_block.out0, y=code_block.out1)
byCoordinates_4 = Point.ByCoordinates(x=code_block.out2, y=code_block.out1)
join = List.Join(list0=byCoordinates, list1=byCoordinates_2, list2=byCoordinates_3, list3=byCoordinates_4)
byCornerPoints = Rectangle.ByCornerPoints(points=join)
setting_out_length = CodeBlock { 1000; }
offset = Curve.Offset(curve=byCornerPoints, distance=setting_out_length)
explode = Geometry.Explode(geometry=offset)
pick_setting_out_point = DSPointOnElementSelection()  # 1 picked in the model
pointsAtChordLengthFromPoint = Curve.PointsAtChordLengthFromPoint(curve=explode@L3, point=pick_setting_out_point, chordLength=setting_out_length)
code_block_2 = CodeBlock { 2; }
flatten_2 = List.Flatten(list=pointsAtChordLengthFromPoint, amt=code_block_2)
code_block_3 = CodeBlock(l=flatten_2) { l[0]; l[2]; }
restOfItems = List.RestOfItems(list=code_block_3.out1)
reverse = List.Reverse(list=code_block_3.out0)
byStartPointEndPoint = Line.ByStartPointEndPoint(startPoint=restOfItems, endPoint=reverse)
code_block_4 = CodeBlock(l=flatten_2) { l[1]; l[3]; }
restOfItems_2 = List.RestOfItems(list=code_block_4.out1)
reverse_2 = List.Reverse(list=code_block_4.out0)
byStartPointEndPoint_2 = Line.ByStartPointEndPoint(startPoint=restOfItems_2, endPoint=reverse_2)
join_2 = List.Join(list0=byStartPointEndPoint, list1=byStartPointEndPoint_2)
intersect = Geometry.Intersect(geometry=flatten@L1, other=join_2)
# note: Custom Node: archilab v.2020.23.9
clear_list = Custom[Clear List](input=intersect@L1)  # This node will remove all Null and Empty Lists from any list.
flatten_3 = List.Flatten(list=clear_list)
intersect_2 = Geometry.Intersect(geometry=byStartPointEndPoint@L1, other=byStartPointEndPoint_2)
flatten_4 = List.Flatten(list=intersect_2)
join_3 = List.Join(list0=flatten_3, list1=flatten_4)
intersect_3 = Geometry.Intersect(geometry=byPatch, other=join_3@L1)
flatten_5 = List.Flatten(list=intersect_3)
byPoint = FamilyInstance.ByPoint(familyType=select_raiser_floor_family, point=flatten_5)
