# Dynamo graph SetCropViewByPickPoint.dyn (Dynamo 2.0.3.8810)

current = Document.Current()
activeView = Document.ActiveView(document=current)
boolean = BoolSelector(true)
pickPoint = RevitModel.Element.PickPoint(fresh=boolean)
pickPoint_2 = RevitModel.Element.PickPoint(fresh=boolean)
X = Point.X(point=pickPoint_2)
Y = Point.Y(point=pickPoint)
byCoordinates = Point.ByCoordinates(x=X, y=Y)
X_2 = Point.X(point=pickPoint)
Y_2 = Point.Y(point=pickPoint_2)
byCoordinates_2 = Point.ByCoordinates(x=X_2, y=Y_2)
join = List.Join(list0=pickPoint, list1=byCoordinates, list2=pickPoint_2, list3=byCoordinates_2)
boolean_2 = BoolSelector(true)
byPoints = PolyCurve.ByPoints(points=join, connectLastToFirst=boolean_2)
curves = PolyCurve.Curves(polyCurve=byPoints)
setCropBoxByCurves = archilab.Revit.Views.Views.SetCropBoxByCurves(view=activeView, curves=curves)
