# Dynamo graph Shared Parameter by Excel.dyn (Dynamo 2.0.4.12684)

file_path = Filename(".\Test.xlsx")
file_from_path = FileObject(path=file_path)
string = StringInput("Sheet1")
boolean = BoolSelector(true)
importExcel = Data.ImportExcel(file=file_from_path, sheetName=string, readAsStrings=boolean)
restOfItems = List.RestOfItems(list=importExcel)
transpose = List.Transpose(lists=restOfItems)
code_block = CodeBlock { 0; 1; 2; }
getItemAtIndex = List.GetItemAtIndex(list=transpose, index=code_block.out0)
getItemAtIndex_2 = List.GetItemAtIndex(list=transpose, index=code_block.out1)
code_block_2 = CodeBlock { "Text"; "PG_TEXT"; }
boolean_2 = BoolSelector(true)
getItemAtIndex_3 = List.GetItemAtIndex(list=transpose, index=code_block.out2)
byName = Category.ByName(name=getItemAtIndex_3)
# note: Custom Node: GeniusLoci v.2021.2.18
create_shared_parameter = Custom[Create Shared Parameter](ParameterName=getItemAtIndex@L1, GroupName=getItemAtIndex_2@L1, ParameterType=code_block_2.out0, ParameterGroup=code_block_2.out1, IsInstance=boolean_2, IsVisible=boolean_2, category=byName@L1)  # Create shared parameters in the shared parameter file and then add it to the project. It is possible to use an existing GUID to recreate an identical shared parameter in a new SP file. Or use the GUID input to simply add the shared parameters to the project. Inspired by archilab
