# Dynamo graph Sheet  View Creator.dyn "Sheet View Creator" (Dynamo 2.0.3.8810)

file_path = Filename("F:\FOR ID\Room Data.xlsx")
file_from_path = FileObject(path=file_path)
string = StringInput("Sheet1")
boolean = BoolSelector(true)
boolean_2 = BoolSelector(true)
importExcel = Data.ImportExcel(file=file_from_path, sheetName=string, readAsStrings=boolean, showExcel=boolean_2)
transpose = List.Transpose(lists=importExcel)
code_block = CodeBlock(l=transpose) { l[0]; l[1]; l[2]; }
family_types = FamilyTypes(index=178)
create = RevitModel.Sheets.Create(sheetNames=code_block.out1, sheetNumbers=code_block.out0, titleBlock=family_types)
get_view_by_name = Custom[Get View By Name](ViewName=code_block.out2)  # Collect views by given name in the active or given document. Based on a Christian Gartland's script.
code_block_2 = CodeBlock { 4; }
chop = List.Chop(list=get_view_by_name, lengths=code_block_2)
ʳʰʸᵗʰᵐ_sheet_packviews = Rhythm.Revit.Views.Sheet.PackViews(sheet=create.Sheets, views=chop)
