# Dynamo graph Telcome tower.dyn (Dynamo 2.1.0.7500)

height = DoubleSlider(35.5, range=25..40 step 0.5)
byCoordinates = Point.ByCoordinates(z=height)
top_radius = DoubleSlider(1.75, range=1..3 step 0.25)
byCenterPointRadius = Circle.ByCenterPointRadius(centerPoint=byCoordinates, radius=top_radius)
# note: Browniris
# www.brownirisbim.com
face = DoubleSlider(3, range=3..6 step 1)
regularPolygon = Polygon.RegularPolygon(circle=byCenterPointRadius, numberSides=face)
curves = PolyCurve.Curves(polyCurve=regularPolygon@L1)
points = Polygon.Points(polygon=regularPolygon)
base_radius = DoubleSlider(5, range=3..10 step 0.5)
byCenterPointRadius_2 = Circle.ByCenterPointRadius(radius=base_radius)
regularPolygon_2 = Polygon.RegularPolygon(circle=byCenterPointRadius_2, numberSides=face)
points_2 = Polygon.Points(polygon=regularPolygon_2)
byStartPointEndPoint = Line.ByStartPointEndPoint(startPoint=points, endPoint=points_2)
number_of_slice = DoubleSlider(8, range=1..15 step 0.5)
pointsAtEqualChordLength = Curve.PointsAtEqualChordLength(curve=byStartPointEndPoint, divisions=number_of_slice)
transpose = List.Transpose(lists=pointsAtEqualChordLength)
boolean = BoolSelector(true)
byPoints = PolyCurve.ByPoints(points=transpose, connectLastToFirst=boolean)
curves_2 = PolyCurve.Curves(polyCurve=byPoints)

# group: Beams
join = List.Join(list0=curves, list1=curves_2)

code_block = CodeBlock { 0.5; }
pointAtParameter = Curve.PointAtParameter(curve=join, param=code_block)
transpose_2 = List.Transpose(lists=pointAtParameter)
code_block_2 = CodeBlock { 1; }
chop = List.Chop(list=points_2, lengths=code_block_2)
code_block_3 = CodeBlock(l=pointsAtEqualChordLength) { t2 = List.Count(l[0]); }
insert = List.Insert(list=pointsAtEqualChordLength@L2, element=chop@L1, index=code_block_3)
firstItem = List.FirstItem(list=insert)
restOfItems = List.RestOfItems(list=insert)
addItemToEnd = List.AddItemToEnd(item=firstItem, list=restOfItems)

# group: Bracings
byStartPointEndPoint_2 = Line.ByStartPointEndPoint(startPoint=transpose_2, endPoint=insert)
byStartPointEndPoint_3 = Line.ByStartPointEndPoint(startPoint=addItemToEnd, endPoint=transpose_2)

join_2 = List.Join(list0=byStartPointEndPoint_2, list1=byStartPointEndPoint_3)
levels = Levels("Level 1")
bracing_type = StructuralFramingTypes("L102X102X6.4")
beamByCurve = StructuralFraming.BeamByCurve(curve=join_2, level=levels, structuralFramingType=bracing_type)
beam_type = StructuralFramingTypes("L102X102X6.4")
braceByCurve = StructuralFraming.BraceByCurve(curve=join, level=levels, structuralFramingType=beam_type)
code_block_4 = CodeBlock(l=pointsAtEqualChordLength) { t2 = List.Count(l[0]); }
insert_2 = List.Insert(list=pointsAtEqualChordLength@L2, element=points@L1, index=code_block_4)
code_block_5 = CodeBlock { 0; }
insert_3 = List.Insert(list=insert_2@L2, element=points_2@L1, index=code_block_5)
byPoints_2 = PolyCurve.ByPoints(points=insert_3)

# group: Column
curves_3 = PolyCurve.Curves(polyCurve=byPoints_2)

column_type = StructuralFramingTypes("Pipe152STD")
braceByCurve_2 = StructuralFraming.BraceByCurve(curve=curves_3, level=levels, structuralFramingType=column_type)
