# Dynamo graph Text by point.dyn (Dynamo 2.0.3.8810)

boolean = BoolSelector(true)
ꟿ_document_activeview = Custom[ꟿ Document.ActiveView](refresh=boolean)  # Selects the current document's active view. Supports more view types than the built-in option. Will be depreciated once the bult in node works with all plan types.
family_types = FamilyTypes(index=10)
select_model_elements = DSModelElementsSelection()  # 1 picked in the model
select_model_elements_2 = DSModelElementsSelection()  # 1 picked in the model
join = List.Join(list0=select_model_elements, list1=select_model_elements_2)
curves = Element.Curves(element=join)
flatten = List.Flatten(list=curves)
startPoint = Curve.StartPoint(curve=flatten)
code_block = CodeBlock { 15; }
pointsAtChordLengthFromPoint = Curve.PointsAtChordLengthFromPoint(curve=flatten, point=startPoint, chordLength=code_block)
ꟿ_familyinstance_byviewandpoint = Custom[ꟿ FamilyInstance.ByViewAndPoint](view=ꟿ_document_activeview, type=family_types, point=pointsAtChordLengthFromPoint)  # Places a view hosted family instance at a given point in the view (e.g. a detail component, 2d annotation). Set track to false if you'd like to place instances on every run.
code_block_2 = CodeBlock { "txt"; }
count = List.Count(list=pointsAtChordLengthFromPoint@L2)
code_block_3 = CodeBlock(n=count) { 300..n*300..300; }
string_from_object = FromObject(obj=code_block_3)
setParameterByName = Element.SetParameterByName(element=ꟿ_familyinstance_byviewandpoint, parameterName=code_block_2, value=string_from_object)
get_revit_activeview = Custom[Get Revit ActiveView]()
code_block_4 = CodeBlock(l=ꟿ_familyinstance_byviewandpoint) { l[1]; }
code_block_5 = CodeBlock { 90; }
setRotation = FamilyInstance.SetRotation(familyInstance=code_block_4, degree=code_block_5)
boolean_2 = BoolSelector(false)
ꟿ_collect_currentselection = Custom[ꟿ Collect.CurrentSelection](refresh=boolean_2)  # Gets the currently selected elements. Connect a boolean switch to refresh the selection.
code_block_6 = CodeBlock {  }
