# Dynamo graph Toposurface wall by sweep.dyn (Dynamo 1.2.1.3083)

XZ = Plane.XZ()

# group: Select Shape
select_model_elements = DSModelElementsSelection()

curves = Element.Curves(select_model_elements)
flatten = Flatten(curves)
byJoinedCurves = PolyCurve.ByJoinedCurves(flatten)
code_block = CodeBlock(l=flatten) { l[0]; }
startPoint = Curve.StartPoint(code_block)
X = Point.X(startPoint)
Y = Point.Y(startPoint)
Z = Point.Z(startPoint)
byOrigin = CoordinateSystem.ByOrigin(X, Y, Z)
YZPlane = CoordinateSystem.YZPlane(byOrigin)
code_block_2 = CodeBlock { 90; }
rotate = CoordinateSystem.Rotate(byOrigin, YZPlane, code_block_2)
select_model_element = DSModelElementSelection()
watch = Watch(select_model_element)
geometry = Element.Geometry(watch)
count = Count(geometry)
code_block_3 = CodeBlock(n=count) { n-1; }
code_block_4 = CodeBlock(l=geometry, n=code_block_3) { l[n]; }
toPolySurface = Custom[Springs.Mesh.ToPolySurface](mesh=code_block_4)  # Converts a Dynamo mesh to a polysurface. Uses multithreading - optimized for 4 cores.
perimeterCurves = Surface.PerimeterCurves(toPolySurface)
coordinateSystemAtParameter = Curve.CoordinateSystemAtParameter(perimeterCurves)
transform = Geometry.Transform(geometry=byJoinedCurves, fromCoordinateSystem=rotate, contextCoordinateSystem=coordinateSystemAtParameter)
sweepAsSolid = Curve.SweepAsSolid(transform, perimeterCurves)
code_block_5 = CodeBlock { 1; }
chop = List.Chop(list=sweepAsSolid, lengths=code_block_5)
categories = Categories("Walls")
code_block_6 = CodeBlock { "Default"; }
byName = Material.ByName(code_block_6)
flatten_2 = Flatten(sweepAsSolid)
count_2 = Count(flatten_2)
code_block_7 = CodeBlock(X=count_2) { "A"..#X..1; }
code_block_8 = CodeBlock(STR_1=code_block_7, STR_2=code_block_7) { STR_4=STR_1<1>+STR_2<2>; }
code_block_9 = CodeBlock(B=code_block_8) { "Wall"+B; }
flatten_3 = Flatten(code_block_9)
code_block_10 = CodeBlock { 0; }
code_block_11 = CodeBlock { 1; }
slice = List.Slice(flatten_3, code_block_10, count_2, code_block_11)
byGeometry = DirectShape.ByGeometry(geometry=chop, category=categories, material=byName, name=slice)
