# Dynamo graph View Rename by Excel V.1.dyn (Dynamo 2.0.3.8810)

file_path = Filename("Ground Floor\b3\Rename.xlsx")
file_from_path = FileObject(path=file_path)
code_block = CodeBlock { "Rename"; }
boolean = BoolSelector(true)
boolean_2 = BoolSelector(true)
importExcel = Data.ImportExcel(file=file_from_path, sheetName=code_block, readAsStrings=boolean, showExcel=boolean_2)
transpose = List.Transpose(lists=importExcel)
code_block_2 = CodeBlock(l=transpose) { l[0]; l[1]; }
get_view_by_name = Custom[Get View By Name](ViewName=code_block_2.out0)  # Collect views by given name in the active or given document. Based on a Christian Gartland's script.
code_block_3 = CodeBlock { "View Name"; }
setParameterByName = Element.SetParameterByName(element=get_view_by_name, parameterName=code_block_3, value=code_block_2.out1)
watch = Watch(code_block_2.out0)
getParameterValueByName = Element.GetParameterValueByName(element=get_view_by_name, parameterName=code_block_3)
contains = Orchid.Common.String.Contains(string=watch, searchFor=getParameterValueByName)
filterByBoolMask = List.FilterByBoolMask(list=watch, mask=contains)
watch_2 = Watch(filterByBoolMask.out)
