# Dynamo graph ViewPurge.dyn (Dynamo 2.0.4.12684)

# group: Runit
# note: Auth : @thiru52k
# Packages used
# Clockwork v.2.3.0
# archilab v.2020.23.9
# Modelical v.2.2.16
# Synthesize v.6.7.1
# Orchid v. 204.1.4.7584
# SteamNodes v.1.2.4
boolean = BoolSelector(true)

# group: Sheet View
code_block = CodeBlock { "Sheets"; }
byName = Category.ByName(name=code_block)
all_elements_of_category = ElementsOfCategory(Category=byName)
views = Sheet.Views(sheet=all_elements_of_category)
flatten = List.Flatten(list=views)
id = Element.Id(element=flatten)

# group: Schedule
all = Orchid.RevitProject.Schedules.Schedule.All()
schedules = Custom[Sheet.Schedules](sheet=all_elements_of_category)  # Returns all schedules placed on a specified sheet
code_block_2 = CodeBlock { 1; }
getItemAtIndex = List.GetItemAtIndex(list=schedules, index=code_block_2)
flatten_2 = List.Flatten(list=getItemAtIndex)
id_2 = Element.Id(element=flatten_2)
id_3 = Element.Id(element=all)

contains = List.Contains(list=id_2, item=id_3@L1)
filterByBoolMask = List.FilterByBoolMask(list=all, mask=contains)
clear_list = Custom[Clear List](input=filterByBoolMask.out)  # This node will remove all Null and Empty Lists from any list.

# group: All View
code_block_3 = CodeBlock { "Views"; }
byName_2 = Category.ByName(name=code_block_3)
all_elements_of_category_2 = ElementsOfCategory(Category=byName_2)
bk_bv_remove_nulls = Custom[BK.bv Remove Nulls](VARList=all_elements_of_category_2)  # forked from Lunchbox
id_4 = Element.Id(element=bk_bv_remove_nulls)

# group: Dependent View
primaryView = Custom[View.PrimaryView](view=bk_bv_remove_nulls)  # Returns the primary view of a given view (i.e. the master view of a dependent view)
bk_bv_remove_nulls_2 = Custom[BK.bv Remove Nulls](VARList=primaryView)
id_5 = Element.Id(element=bk_bv_remove_nulls_2)
clear_list_2 = Custom[Clear List](input=id_5)

# group: Parent View
code_block_4 = CodeBlock { "Parent View"; }
getParameterValueByName = Element.GetParameterValueByName(element=bk_bv_remove_nulls, parameterName=code_block_4)
bk_bv_remove_nulls_3 = Custom[BK.bv Remove Nulls](VARList=getParameterValueByName)
id_6 = Element.Id(element=bk_bv_remove_nulls_3)
clear_list_3 = Custom[Clear List](input=id_6)

join = List.Join(list0=id, list1=clear_list_2, list2=clear_list_3)
uniqueItems = List.UniqueItems(list=join)
contains_2 = List.Contains(list=uniqueItems, item=id_4@L1)
filterByBoolMask_2 = List.FilterByBoolMask(list=bk_bv_remove_nulls, mask=contains_2)
bk_bv_remove_nulls_4 = Custom[BK.bv Remove Nulls](VARList=filterByBoolMask_2.out)
join_2 = List.Join(list0=clear_list, list1=bk_bv_remove_nulls_4)
runMe = Custom[Tool.RunMe](Boolean=boolean, ThingToDo=join_2)  # Use Boolean to perform an action
deleteElements = Custom[DeleteElements](elemOrId=runMe)  # Delete Revit elements by element or by ID
