# Dynamo graph parameter value transfer.dyn (Dynamo 1.2.1.3083)

element_getparametervaluebyname = Custom[Element.GetParameterValueByName(CaSe iNSeNSiTive)]()  # Get the value of one of the element's parameters. (CaSe iNSeNSiTiVe); unwired: element, parameterName
categories = Categories("Doors")
all_elements_of_category = ElementsOfCategory(categories)
code_block = CodeBlock { "ManufacturersPartNo"; }
code_block_2 = CodeBlock { "Manufacturers Part No"; }
getparametervaluebyname = Custom[GetParameterValueByName(TypeOrInstance)](element=all_elements_of_category, parameterName=code_block_2)  # Gets a parameter value by name regardless of type or instance.
setparameterbyname = Custom[SetParameterByName(TypeOrInstance)](element=all_elements_of_category, parameterName=code_block, value=getparametervaluebyname)  # Set one of the element's parameters regardless of parameter type or instance.
