# Dynamo graph pipe by layers.dyn (Dynamo 2.3.0.5885)
# packages: DynaMEP 1.2.8, bimorphNodes 4.0.13, Universo_BIM 19.10.11, Data-Shapes 2022.2.103, designtech 1.0.8

# note: Browniris
# www.brownirisbim.com
# Package Used
# DynaMEP v.1.2.8
# BimorphNodes v.4.0.13
# designtech v.1.0.8
# Data-Shapes v.2022.2.103
boolean = BoolSelector(true)
# note: Custom Package: DynaMEP v.1.2.8
getCadLinked = CAD.CADLinked.GetCadLinked(fresh=boolean)
string = StringInput("Proceed")
string_2 = StringInput("CAD Layer Name")
# note: Custom Package: BimorphNodes v.4.0.13
layerNames = CAD.LayerNames(importInstance=getCadLinked.importinstance)
flatten = List.Flatten(list=layerNames)
# note: Data-Shape
dropdown_data = Custom[DropDown Data](InputName=string_2, Keys=flatten, Values=flatten)  # package Data-Shapes; Create data for DropDown input in UI.MultiInputForm ++ . Check out www.data-shapes.net for more infos.
string_3 = StringInput("Piping System")
nameCollector = Elements.PipingSystemType.NameCollector()
byName = Elements.PipingSystemType.ByName(name=nameCollector)
dropdown_data_2 = Custom[DropDown Data](InputName=string_3, Keys=nameCollector, Values=byName)
string_4 = StringInput("Pipe Type")
boolean_2 = BoolSelector(true)
# note: Custom Node: DynaMEP v.1.2.8
allPipeTypes = MEP.Pipes.AllPipeTypes(fresh=boolean_2)
dropdown_data_3 = Custom[DropDown Data](InputName=string_4, Keys=allPipeTypes.nameTypes, Values=allPipeTypes.PipeTypes)
string_5 = StringInput("Level")
# note: Custom Node: designtech v.1.0.8
levelsCollector = dtRevit.Collector.LevelsCollector()
name = Element.Name(element=levelsCollector)
# note: Custom Node: Data-Shapes v.2022.2.103
dropdown_data_4 = Custom[DropDown Data](InputName=string_5, Keys=name, Values=levelsCollector)
join = List.Join(list0=dropdown_data, list1=dropdown_data_2, list2=dropdown_data_3, list3=dropdown_data_4)
boolean_3 = BoolSelector(true)
string_6 = StringInput("Cancel")
multipleinputform = Custom[MultipleInputForm ++](ButtonText_optional=string, Inputs=join, Toggle=boolean_3, CancelButtonText_optional=string_6)  # package Data-Shapes; Create a form with multiple inputs. see www.data-shapes.net for tutorials and infos!
code_block = CodeBlock(l=multipleinputform.User_Inputs) { l[0]; l[1]; l[2]; l[3]; }
# note: Custom Node: BimorphNodes v.4.0.13
curvesFromCADLayers = CAD.CurvesFromCADLayers(importInstance=getCadLinked.importinstance, layerNames=code_block.out0)
byCurve = Elements.Pipe.ByCurve(curve=curvesFromCADLayers.Curve, pipingSystemType=code_block.out1, pipeType=code_block.out2, level=code_block.out3)
